# Grasshopper definition dented_cube.gh (Grasshopper 1.0.7)
# plug-ins: Karamba, LunchBox

xy_plane = XYPlane(Origin=Point(0, 0, 0))
center_box = CenterBox(Base=xy_plane, X=Slider(150, range=0..1000), Y=Slider(200, range=0..1000), Z=Slider(200, range=0..1000))
deconstruct_brep = DeconstructBrep(Brep=center_box)  # -> Faces, Edges, Vertices
quad_panels = QuadPanels(Surface=deconstruct_brep.Faces, UDivisions=Slider(5, range=0..10), VDivisions=Slider(5, range=0..10))  # -> simplify(Panels)
construct_path = ConstructPath(Indices=Slider(5, range=0..5))
tree_branch = TreeBranch(Tree=quad_panels, Path=construct_path, MaintainPaths=True)
list_length = ListLength(List=tree_branch)
division = Division(A=list_length, B="2")
round = Round(Number=division)  # -> Nearest, Floor, Ceiling
unit_z = UnitZ(Factor=Slider(320, range=0..1000))
list_item = ListItem(List=tree_branch, Index=round.Floor, Wrap=True)
negative = Negative(Value=unit_z)
move = Move(Geometry=list_item, Motion=negative)  # -> Geometry, Transform
deconstruct_brep_2 = DeconstructBrep(Brep=list_item)  # -> Faces, Edges, Vertices
deconstruct_brep_3 = DeconstructBrep(Brep=move.Geometry)  # -> Faces, Edges, Vertices
merge = Merge(Data1=graft(deconstruct_brep_2.Edges), Data2=graft(deconstruct_brep_3.Edges))  # -> simplify(Result)
fit_loft = FitLoft(Curves=merge, CountU=15, DegreeU=5, DegreeV=5)
quad_panels_2 = QuadPanels(Surface=fit_loft, UDivisions=Slider(1, range=0..10), VDivisions=Slider(3, range=0..10))  # -> simplify(Panels)
brep = Brep(quad_panels_2)
brep_2 = Brep(quad_panels)
merge_2 = Merge(Data1=brep_2, Data2=brep)  # -> flatten(Result)
deconstruct_brep_4 = DeconstructBrep(Brep=merge_2)  # -> Faces, Edges, Vertices
remove_duplicate_lines_karamba3d = RemoveDuplicateLinesKaramba3D(Line=flatten(deconstruct_brep_4.Edges), LimitDistance=0.005)  # -> OutLine, Info, Indexes
curve = Curve(remove_duplicate_lines_karamba3d.OutLine)
